# Grasshopper definition Grasshopper_scripts.gh (Grasshopper 1.0.8)
# plug-ins: Pufferfish, Eddy3D, PachydermGH

panel = Panel("https://climate.onebuilding.org/WMO_Region_6_Europe/NLD_Netherlands/NH_Noord-Holland/NLD_NH_Amsterdam-Schipol.AP.062400_TMYx.zip")
downloadepw = LBDownloadWeather(weather_URL=panel)  # -> epw_file, stat_file, ddy_file; plug-in component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
panel_2 = Panel("https://climate.onebuilding.org/WMO_Region_6_Europe/NLD_Netherlands/NH_Noord-Holland/NLD_NH_Amsterdam-Schipol.AP.062400_TMYx.zip")

importepw = LBImportEPW(epw_file=downloadepw.epw_file)  # -> location, dry_bulb_temperature, dew_point_temperature, relative_humidity, wind_speed, wind_direction, direct_normal_rad, diffuse_horizontal_rad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; plug-in component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
# Wind assessment
number_slider = Slider(12.65, range=0..25)
pt = Point(Point(120172.54, 482887.9194, 0))
analysisperiod = LBAnalysisPeriod(start_month="6", start_day="12", start_hour="0", end_month="6", end_day="12", end_hour="23")  # -> period, hoys, dates; plug-in component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
legendpar = LBLegendParameters(min="0", max="17", seg_count="18", vert_or_horiz=Toggle(False), base_plane=pt, seg_height=number_slider)  # -> leg_par; plug-in component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
# Sunlight assessment
sunpath = LBSunPath(location=importepw.location, hoys=analysisperiod.hoys, scale=1)  # -> report, vectors, altitudes, azimuths, hoys, sun_pts, analemma, daily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; disabled; plug-in component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
geo = Geometry([<mesh referenced from the Rhino model> x170])
directsunhours = LBDirectSunHours(vectors=flatten(sunpath.vectors), geometry=flatten(geo), grid_size="4", legend_par=legendpar, run=Toggle(False))  # -> report, points, results, mesh, legend, title, int_mtx; plug-in component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

# ----
# Pollution assessment
# 1. Geometry &
# Boundary Conditions
number_slider_2 = Slider(230, range=0..360)
downloadepw_2 = LBDownloadWeather(weather_URL=panel_2)  # -> epw_file, stat_file, ddy_file; plug-in component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
abl = ABLFlow(WindDirections=number_slider_2, GroundLevel="-5", WeatherFile=downloadepw_2.epw_file)

vec = VectorXYZ(XComponent="5", YComponent="5", ZComponent="0")  # -> Vector, Length
windvector = Butterfly_WindVector(wind_speed=Slider(5, range=0..400), wind_direction=Point(0, 1, 0))  # -> wind_vector; plug-in component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

brep = Brep([<brep referenced from the Rhino model> x2])
cluster = Cluster_2()  # disabled
# 2. Simulation Domain
mesh = Mesh([<mesh referenced from the Rhino model> x30])
panel_3 = Panel("""type fixedGradient;
gradient uniform 0.05;""")
bbox = BoundingBox(Content=brep, Plane=PlaneXY(0, 0, 0))  # -> Box, Box_2

panel_4 = Panel(windvector)
devec = DeconstructVector(Vector=windvector)  # -> XComponent, YComponent, ZComponent
format = Format(
    Format="type fixedValue; value uniform ({0} {1} {2});",
    Culture=127,
    Data0=devec.XComponent,
    Data1=devec.YComponent,
    Data2=devec.ZComponent)
panel_5 = Panel(format)

boundary = Butterfly_Boundary(T=panel_3)  # -> report, boundary; plug-in component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
dombox = BoxDomain(Buildings=mesh, BoundaryCondition=abl, CellSize=Slider(20, range=0..20))  # -> Domain, PreviewMesh
box_corners = BoxCorners(Box=bbox.Box)  # -> CornerA, CornerB, CornerC, CornerD, CornerE, CornerF, CornerG, CornerH
panel_6 = Panel([box_corners.CornerA, box_corners.CornerG])
brep_2 = Brep(<brep referenced from the Rhino model>)
mesh_2 = Mesh([<mesh referenced from the Rhino model> x65])
createbfgeometry = Butterfly_CreateButterflyGeometry(name="buildings", geo=flatten(mesh_2))  # -> report, BF_geo; plug-in component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
createbfgeometry_2 = Butterfly_CreateButterflyGeometry(name="roads", geo=flatten(brep_2), boundary=boundary.boundary)  # -> report, BF_geo; plug-in component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
format_2 = Format(Format="({0}) ({1})", Culture=127, Data0=box_corners.CornerA, Data1=box_corners.CornerG)  # -> flatten(Text)
mset = MeshSettings(
    BuildingMinLevel="2",
    BuildingMaxLevel="3",
    FeatureLevel="3",
    BoundingBoxLevel=0,
    GroundLevel="2",
    BoundaryLayers=1,
    CellsBetweenLevels=4,
    MeshMode=4,
    Preset=1)
rset = RunSettings(
    Iterations="10",
    WriteInterval=20,
    TimestepsToKeep=3,
    TurbulenceModel=1,
    RelaxationFactors=3,
    NumericalSchemes=1,
    PotentialFlowInit=False,
    AgeOfAir=False,
    CPUCores="1",
    BlueCFDFolder="C:\Users\enshanchen\AppData\Local\Eddy3D\Cases\selfDefined",
    DebugDiagnostics=False,
    SIMPLEC=False)
# 3. Mesh & Simulation
windsim = WindSimulation(
    SimulationDomain=dombox.Domain,
    WorkingDirectory="3_SimpleWindAnalysis_new_meshManualRebuild_3",
    MeshSettings=mset,
    RunSettings=rset,
    RunMeshing=Button(),
    MakeTrees=False,
    RunSimulation=Button(),
    SelectedEngine=1)  # -> SimulationResult, MeshDone, SimDone, MeshRemainingTime, SimulationRemainingTime
residuals = VisualizeResiduals(Result=windsim.SimulationResult, Plot=Button())
panel_8 = Panel(format_2)
merge = Merge(Data1=createbfgeometry_2.BF_geo, Data2=createbfgeometry.BF_geo)

casefromgeos = Butterfly_CreateCaseFromGeometries(BF_geo=flatten([createbfgeometry.BF_geo, createbfgeometry_2.BF_geo]), expand_block_mesh=True, run=Toggle(True))  # -> report, block_pts, case; plug-in component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

# ----
# 4. Probing points & probing
panel_9 = Panel(windsim.SimulationResult)
createcasefromtunnel = Butterfly_CreateCaseFromTunnel(BF_geo=flatten(merge), wind_vector=flatten(windvector), ref_wind_height=10, landscape=6, run=Toggle(True))  # -> report, block_pts, wind_tunnel, case; plug-in component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
panel_10 = Panel(merge)

unit_z = UnitZ(Factor="2")
brep_3 = Brep(<brep referenced from the Rhino model>)
move = Move(Geometry=brep_3, Motion=unit_z)  # -> Geometry, Transform
brep_to_grid_points = BrepToGridPoints(Geometry=move.Geometry, Spacing=Slider(3, range=0..10), Run=True)  # -> Points, Status

blockmesh = Butterfly_blockMesh(case=createcasefromtunnel.case, overwrite=True, run=Toggle(False))  # -> report, case; plug-in component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
panel_11 = Panel(createcasefromtunnel.case)
panel_12 = Panel(createcasefromtunnel.block_pts)
pt_2 = Point(<point referenced from the Rhino model>)
panel_13 = Panel("C:\Users\enshanchen\AppData\Local\Eddy3D\Cases\3_SimpleWindAnalysis_new_meshManualRebuild_3\230\postProcessing\ttt_s\200\s")
snappyhexmesh = Butterfly_snappyHexMesh(case=blockmesh.case, location_in_mesh=pt_2, run=Toggle(False))  # -> report, case; plug-in component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
heattransfer = Butterfly_HeatTransferRecipe()  # -> report, recipe; plug-in component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
toggle = BooleanToggle(False)
probing = Probing(Result=panel_13, NameOfInstance="ttt_s2", InterpolationScheme=3, NameOfField=0, Run=Button())  # -> ProbingPoints, ProbingResult
solution = Butterfly_Solution(
    case=snappyhexmesh.case,
    recipe=heattransfer.recipe,
    solution_par=Slider(400, range=0..400),
    interval=2,
    write=toggle,
    run=toggle)  # -> report, solution, is_running, timestep, residual_fields, residual_values, log_files; plug-in component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
panel_14 = Panel("C:\Users\enshanchen\AppData\Local\Eddy3D\Cases\3_SimpleWindAnalysis_new_meshManualRebuild_3\230\postProcessing\ttt_s\200\s_gh.txt")
# 5. Post-processing
# 5.1. Paraview
button = Button()
# 5.2. Wind vectors
points = Data(brep_to_grid_points.Points)
panel_15 = Panel(solution.solution)
panel_16 = Panel(solution.residual_fields)
file = ReadFile(File=panel_14, PerLineParse=True)
paraview = Paraview(Result=windsim.SimulationResult, WindDirections=number_slider_2, Run=button)
cluster_2 = Cluster(data=file)  # -> S, E, data_3
gradient = Gradient(
    LowerLimit=cluster_2.S,
    UpperLimit="0.3",
    Parameter=cluster_2.data_3,
    stops=[0.103: RGB(0, 0, 255), 0.22: RGB(0, 170, 255), 0.305: RGB(0, 255, 255), 0.398: RGB(0, 255, 188), 0.504: RGB(0, 255, 106), 0.605: RGB(91, 255, 0), 0.699: RGB(184, 255, 0), 0.799: RGB(255, 255, 0), 0.898: RGB(255, 170, 0)])
createlegend = LBCreateLegend(values=[cluster_2.E, cluster_2.S])  # -> mesh, title_obj, label_objs, label_text, colors; plug-in component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
cloud = CloudDisplay(Points=points, Colours=gradient, Size=Slider(3, range=0..10), SpriteType=0)
mesh_3 = Mesh(createlegend.mesh)
preview = CustomPreview(Geometry=createlegend.mesh, Material=createlegend.colors)

geo_2 = Geometry(<mesh referenced from the Rhino model>)
brep_4 = Brep([<brep referenced from the Rhino model> x2])
srf = Surface()
lng = ListLength(List=brep_4)
crv = Curve(<curve referenced from the Rhino model>)
repeat = RepeatData(Data="0", Length=lng)
panel_17 = Panel("1")
traffic_source = FWHATrafficLineSource(
    Curve=crv,
    Pavement=0,
    Speed=100,
    Automobiles="100",
    MediumTrucks="0",
    HeavyTrucks="0",
    Buses="0",
    Motorcyles="0",
    FullThrottle="0",
    SamplesPerMeter=Slider(1, range=0..5))
poly_scene = PolygonScene(RhinoGeometry=Toggle(False), GrasshopperGeometry=brep_4, GrasshopperLayers=repeat, VoxelGridDepth=7)
geo_3 = Geometry(<surface referenced from the Rhino model>)
panel_18 = Panel("0")
pt_3 = Point(Point(119451.1031, 483322.5376, 0))
pdecon = Deconstruct(Point=pt_3)  # -> XComponent, YComponent, ZComponent
geosrc = GeodesicSource(Power=[120, 120, 120, 120, 120, 120, 120, 120], Delay=0)
addition = Addition(A=pdecon.ZComponent, B=Slider(6, range=0..50))
pach_rt = RayTracing(
    RoomModel=poly_scene,
    NumberOfRays="1000",
    CutOffTime="10",
    Source=traffic_source,
    Receiver=geo_3,
    FrequencyScope=Domain(0, 7))
pt_4 = ConstructPoint(XCoordinate=pdecon.XComponent, YCoordinate=pdecon.YComponent, ZCoordinate=addition)
vecstar = VectorStar(Plane=pt_4, Steps=Slider(5, range=0..50), SubdivisionType=0, Dimensionality=False)  # -> Vectors, Lines
geosrc_2 = GeodesicSource(Origin=pt_4, Power=[120, 120, 120, 120, 120, 120, 120, 120], Delay=0)
sph = Sphere(Base=PlaneXY(0, 0, 0), Radius=1)
panel_20 = Panel(traffic_source)
devec_2 = DeconstructVector(Vector=vecstar.Vectors)  # -> XComponent, YComponent, ZComponent
vec2pt = Vector2Pt(PointA=Point(119449.9805, 483328.1137, 0), PointB=Point(119457.1784, 483327.9906, 0), Unitize=False)  # -> Vector, Length
larger = LargerThan(FirstNumber=devec_2.YComponent, SecondNumber="0")  # -> LargerThan, OrEqualTo
popgeo = PopulateGeometry(Geometry=sph, Count=100, Seed=1)
pachvisrays = VisualizePachydermRays(RoomModel=poly_scene, Source=traffic_source, RayDirections=popgeo, NumberOfBounces=Slider(2, range=0..5))  # -> RayCurves, EndPoints, ArrivalTimeDelay, Itensity
cull = CullPattern(List=vecstar.Vectors, CullPattern=invert(larger.LargerThan))
vdis = VectorDisplay(Anchor=pt_4, Vector=cull)
panel_21 = Panel(pachvisrays.RayCurves)

number_slider_3 = Slider(230, range=0..360)

# ----
# 2. Simulation Domain
# 1. Geometry &
# Boundary Conditions
panel_22 = Panel("-5")
mesh_4 = Mesh([<mesh referenced from the Rhino model> x30])
brep_5 = Brep(<brep referenced from the Rhino model>)

abl_2 = ABLFlow(WindDirections=number_slider_3, GroundLevel=panel_22, WeatherFile=downloadepw.epw_file)

cluster_3 = Cluster_2()  # disabled
dombox_2 = BoxDomain(Buildings=mesh_4, BoundaryCondition=abl_2, CellSize=Slider(20, range=0..20))  # -> Domain, PreviewMesh

# ----
# 3. Mesh & Simulation
panel_23 = Panel("3_SimpleWindAnalysis_new_meshManualRebuild_3")
mset_2 = MeshSettings(
    BuildingMinLevel="2",
    BuildingMaxLevel="3",
    FeatureLevel="3",
    BoundingBoxLevel=0,
    GroundLevel="2",
    BoundaryLayers=1,
    CellsBetweenLevels=4,
    MeshMode=4,
    Preset=1)
rset_2 = RunSettings(
    Iterations="10",
    WriteInterval=20,
    TimestepsToKeep=3,
    TurbulenceModel=1,
    RelaxationFactors=3,
    NumericalSchemes=1,
    PotentialFlowInit=False,
    AgeOfAir=False,
    CPUCores="1",
    DebugDiagnostics=False,
    SIMPLEC=False)
windsim_2 = WindSimulation(
    SimulationDomain=dombox_2.Domain,
    WorkingDirectory=panel_23,
    MeshSettings=mset_2,
    RunSettings=rset_2,
    RunMeshing=Button(),
    MakeTrees=False,
    RunSimulation=Button(),
    SelectedEngine=1)  # -> SimulationResult, MeshDone, SimDone, MeshRemainingTime, SimulationRemainingTime; disabled
residuals_2 = VisualizeResiduals(Result=windsim_2.SimulationResult, Plot=Button())

panel_24 = Panel(windsim_2.SimulationResult)

# ----
# 4. Probing points & probing
panel_25 = Panel("2")
unit_z_2 = UnitZ(Factor=panel_25)
brep_6 = Brep(<brep referenced from the Rhino model>)
move_2 = Move(Geometry=brep_5, Motion=unit_z_2)  # -> Geometry, Transform
brep_to_grid_points_2 = BrepToGridPoints(Geometry=move_2.Geometry, Spacing=Slider(3, range=0..10), Run=True)  # -> Points, Status
probing_2 = Probing(
    Result=windsim_2.SimulationResult,
    ProbingPoints=brep_to_grid_points_2.Points,
    NameOfInstance="ttt",
    InterpolationScheme=3,
    NameOfField=0,
    Run=Button())  # -> ProbingPoints, ProbingResult

# ----
# 5. Post-processing
# 5.1. Paraview
# 5.2. Wind vectors
points_2 = Data(probing_2.ProbingPoints)
vectors = Data(probing_2.ProbingResult)
paraview_2 = Paraview(Result=windsim_2.SimulationResult, WindDirections=number_slider_3, Run=Button())
cluster_4 = Cluster(data=vectors)  # -> S, E, data_3
gradient_2 = Gradient(
    LowerLimit=cluster_4.S,
    UpperLimit=cluster_4.E,
    Parameter=cluster_4.data_3,
    stops=[0.103: RGB(0, 0, 255), 0.22: RGB(0, 170, 255), 0.305: RGB(0, 255, 255), 0.398: RGB(0, 255, 188), 0.504: RGB(0, 255, 106), 0.605: RGB(91, 255, 0), 0.699: RGB(184, 255, 0), 0.799: RGB(255, 255, 0), 0.898: RGB(255, 170, 0)])
amplitude = Amplitude(Vector=vectors, Amplitude=Slider(4, range=0..10))
vdisex = VectorDisplayEx(Point=points_2, Vector=amplitude, Colour=gradient_2, Width=Slider(2, range=0..10))

reslive = LiveResiduals(Result=windsim_2.SimulationResult, Live=True, WindDirection=-1)
panel_26 = Panel(amplitude)

# ----
# 6. Clean
button_2 = Button()
clean = CleanDirectories(ResultDirectory=panel_23, Mode=2, Run=button_2)

panel_27 = Panel(vectors)
panel_28 = Panel([cluster_4.S, cluster_4.E])
panel_29 = Panel(cluster_4.data_3)
panel_30 = Panel(probing_2.ProbingPoints)
createlegend_2 = LBCreateLegend(values=[cluster_4.E, cluster_4.S])  # -> mesh, title_obj, label_objs, label_text, colors; plug-in component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
mesh_5 = Mesh(createlegend_2.mesh)
preview_2 = CustomPreview(Geometry=createlegend_2.mesh, Material=createlegend_2.colors)

# ==== cluster Cluster
data = ClusterInput()
data_2 = Data(data)
data_3 = ClusterOutput(data_2)
bnd = Bounds(Numbers=data_2)
dedomain = DeconstructDomain(Domain=bnd)  # -> Start, End
S = ClusterOutput(dedomain.Start)
E = ClusterOutput(dedomain.End)

# ==== cluster Cluster_2
geo = Geometry([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])
mesh = Mesh(geo)
mjoin = MeshJoin(Meshes=mesh)
M = ClusterOutput(mjoin)
